# Dynamo graph Pretratamiento BIM.dyn (Dynamo 1.3.3.4111)

ancho_de_canal_w = DoubleInput(2)
tirante_h = DoubleInput(0.5)
bordo_libre_tirante_hb_h = DoubleInput(1)
caudal_q = DoubleInput(2)
ángulo_de_barras_theta = DoubleInput(45)
espacio_entre_barras_c = DoubleInput(0.03)
espesor_de_barras_db = DoubleInput(0.02)
python_script = Python(IN[0]=ancho_de_canal_w, IN[1]=tirante_h, IN[2]=bordo_libre_tirante_hb_h, IN[3]=caudal_q, IN[4]=ángulo_de_barras_theta, IN[5]=espacio_entre_barras_c, IN[6]=espesor_de_barras_db)
# ---------- python_script.python (88 lines) ----------
import clr
import math
clr.AddReference('ProtoGeometry')
from Autodesk.DesignScript.Geometry import *

W = IN[0]
h = IN[1]
hb = IN[2]
Q = IN[3]
theta = IN[4]
C = IN[5]
db = IN[6]

g = 9.81

# PRELIMINARES

theta_rad = math.radians(theta)
Ht = h + hb

# ÁREA DEL CANAL

A = W * h

# VELOCIDAD ANTES DE LAS REJILLAS

if A <= 0:
	V = None
else: 
	V = Q / A

# LONGITUD DE LA BARRA

if math.sin(theta_rad) <= 0:
	L = None
else: 
	L = (h + hb) / math.sin(theta_rad)
	
# NÚMERO DE BARRAS

if (C + db) <= 0:
	n = None
else: 
	n = ((W - C) / (C + db)) - 1

if n is not None: 
	n = int(math.ceil(n))
	
# VELOCIDAD DE ACERCAMIENTO

if (W - db) * h <= 0:
	Va = None
else:
	Va = Q / ((W - db) * h)

# ÁREA DE LAS REJAS

Ar = n * db * h

# VELOCIDAD EN LA REJA

if A - Ar <= 0:
	Vr = None
else:
	Vr = Q / (A - Ar)
	
# PÉRDIDA HIDRÁULICA

if Vr < 0 or Va < 0:
	hL = None
else: 
	hL = (1.0 / 0.7) * ((Vr**2 - Va**2) / (2 * g))
	
if hL is not None and hL < 0:
	hL = 0 
	
# SALIDA EN DICCIONARIO

OUT = {
	A, 
	V, 
	L, 
	n,
	Va, 
	Ar, 
	Vr, 
	hL
}
# ----------------------------------------
losa_p1 = Point.ByCoordinates()
espesor_de_muros_del_canal_e = DoubleInput(0.2)
python_script_2 = Python(IN[0]=ancho_de_canal_w, IN[1]=espesor_de_muros_del_canal_e)
# ---------- python_script_2.python (10 lines) ----------
import clr
clr.AddReference('ProtoGeometry')
from Autodesk.DesignScript.Geometry import *

W = IN[0]
e = IN[1]

point1 = W + e + e

OUT = point1
# ----------------------------------------
losa_p2 = Point.ByCoordinates(x=python_script_2)
losa_l1 = Line.ByStartPointEndPoint(startPoint=losa_p1, endPoint=losa_p2)
longitud_del_canal_lc = DoubleInput(5)
losa_p3 = Point.ByCoordinates(x=python_script_2, y=longitud_del_canal_lc)
losa_l2 = Line.ByStartPointEndPoint(startPoint=losa_p2, endPoint=losa_p3)
losa_p4 = Point.ByCoordinates(y=longitud_del_canal_lc)
losa_l3 = Line.ByStartPointEndPoint(startPoint=losa_p3, endPoint=losa_p4)
losa_l4 = Line.ByStartPointEndPoint(startPoint=losa_p4, endPoint=losa_p1)
losa_polígono = List.Create(losa_l1, losa_l2, losa_l3, losa_l4)
tipo_de_material_losa = FloorTypes("Concreto")
number_tipo_de_suelo = DoubleInput(0)
getItemAtIndex = List.GetItemAtIndex(list=tipo_de_material_losa, index=number_tipo_de_suelo)
levels = Levels("Nivel 1")
byOutlineTypeAndLevel = Floor.ByOutlineTypeAndLevel(outlineCurves=losa_polígono, floorType=getItemAtIndex, level=levels)
muros_p1 = Point.ByCoordinates(z=bordo_libre_tirante_hb_h)
muros_p2 = Point.ByCoordinates(y=longitud_del_canal_lc, z=bordo_libre_tirante_hb_h)
muro_1_l1 = Line.ByStartPointEndPoint(startPoint=muros_p1, endPoint=muros_p2)
muro_1_l2 = Line.ByStartPointEndPoint(startPoint=muros_p1, endPoint=losa_p1)
muro_1_l3 = Line.ByStartPointEndPoint(startPoint=muros_p2, endPoint=losa_p4)
muro_1_l4 = Line.ByStartPointEndPoint(startPoint=losa_p1, endPoint=losa_p4)
lista_muro_1 = List.Create(muro_1_l1, muro_1_l2, muro_1_l3, muro_1_l4)
number = DoubleInput(1)
shiftIndices = List.ShiftIndices(list=lista_muro_1, amount=number)
wall_types = WallTypes("PTAR_Muro_Concreto")
number_tipo_de_muro = DoubleInput(0)
getItemAtIndex_2 = List.GetItemAtIndex(list=wall_types, index=number_tipo_de_muro)
muro_1 = Wall.ByCurveAndHeight(curve=shiftIndices, height=bordo_libre_tirante_hb_h, level=levels, wallType=getItemAtIndex_2)
muros_p3 = Point.ByCoordinates(x=python_script_2, z=bordo_libre_tirante_hb_h)
muros_p4 = Point.ByCoordinates(x=python_script_2, y=longitud_del_canal_lc, z=bordo_libre_tirante_hb_h)
muro_2_l1 = Line.ByStartPointEndPoint(startPoint=muros_p3, endPoint=muros_p4)
muro_2_l2 = Line.ByStartPointEndPoint(startPoint=muros_p3, endPoint=losa_p2)
muro_2_l3 = Line.ByStartPointEndPoint(startPoint=muros_p4, endPoint=losa_p3)
lista_muro_2 = List.Create(muro_2_l1, muro_2_l2, muro_2_l3, losa_l2)
